# Grasshopper definition grassflow_string formatter.gh (Grasshopper 1.0.7)

poissions_ratio = Slider(0.3, range=0.173..0.528)
run_model = BooleanToggle(True)
sheer_modulus = Slider(100, range=13.44..100)
tip_force = Slider(0.007017, range=0.00132..0.00895)
train_network = BooleanToggle(False)
panel = Panel("C:\Users\Ahmad\Documents\PycharmProjects\tenhopper\grassflow.py")
layers_flatten = CSharpScript()  # -> out, A; inputs input: String
# ---------- layers_flatten: C# ----------
    A = "Flatten";
# ---------- end layers_flatten ----------
neg = Negative(Value=tip_force)
merge = Merge(Data1=simplify(poissions_ratio), Data2=simplify(sheer_modulus), Data3=simplify(neg))
layers_dense = CSharpScript(x=layers_flatten.A, units="5", activation="relu")  # -> out, A; inputs units: String, activation: String
# ---------- layers_dense: C# usings ----------
using System.IO;
using System.Linq;
using System.Data;
using System.Drawing;
using System.Reflection;
using System.Windows.Forms;
using System.Xml;
using System.Xml.Linq;
using System.Runtime.InteropServices;

using Rhino.DocObjects;
using Rhino.Collections;
using GH_IO;
using GH_IO.Serialization;
# ---------- layers_dense: C# ----------
    A = x + "," + "Dense:units=" + units + ":" + "activation=" + activation;
# ---------- end layers_dense ----------
join = TextJoin(Text=merge, Join=",")  # -> flatten(Result)
layers_dense_2 = CSharpScript(x=layers_dense.A, units="4", activation="sigmoid")  # -> out, A; inputs units: String, activation: String; same code as layers_dense
model_compile = CSharpScript(
    layers=layers_dense_2.A,
    optimizer="adam",
    loss="mean_squared_error",
    filePath="C:\Users\Ahmad\Documents\Demo\Data\",
    pyPath=panel,
    inputData=join,
    train=train_network,
    run=run_model)  # -> graft(output); inputs layers: String, optimizer: String, loss: String, filePath: String, pyPath: String, inputData: list of String, train: Boolean, run: Boolean
# ---------- model_compile: C# ----------
    List<string> outputStr = new List<string>();
    string layerStr = layers;
    outputStr.Add(layerStr);
    outputStr.Add(optimizer + ":" + "learning_rate=0.01");
    outputStr.Add("loss:" + loss);
    outputStr.Add(filePath);

    // python
    if(!run) return;

    string python = @"C:\Users\Ahmad\Documents\TensorFlow\venv\Scripts\pythonw.exe";

    // python app to call
    string myPythonApp = pyPath;

    // Create new process start info
    System.Diagnostics.ProcessStartInfo myProcessStartInfo = new System.Diagnostics.ProcessStartInfo(python);
    // make sure we can read the output from stdout
    myProcessStartInfo.UseShellExecute = false;
    myProcessStartInfo.RedirectStandardOutput = true;
    myProcessStartInfo.RedirectStandardInput = true;

    // start python app with 3 arguments
    //myProcessStartInfo.Arguments = myPythonApp + " " + x + " " + y;
    //string argument = "";
    //argument += myPythonApp + " ";
    myProcessStartInfo.Arguments = myPythonApp;
    if (train) {
      myProcessStartInfo.Arguments += " --train";
    }

    if (train && myProcess != null) {
      myProcess.StandardInput.Close();
      myProcess.Close();
      myProcess = null;
    }

    if (myProcess == null) {
      myProcess = new System.Diagnostics.Process();
      // assign start information to the process
      myProcess.StartInfo = myProcessStartInfo;

      // start the process
      myProcess.Start();
      for(int i = 0;i < outputStr.Count;i++)
        myProcess.StandardInput.WriteLine(outputStr[i]);
    }
    foreach(string s in inputData)
    {
      myProcess.StandardInput.WriteLine(s);
    }

    myProcess.StandardInput.Flush();

    // Read the standard output of the app we called.
    // in order to avoid deadlock we will read output first
    // and then wait for process terminate:
    System.IO.StreamReader myStreamReader = myProcess.StandardOutput;
    string myString = myProcess.StandardOutput.ReadLine();
    //myProcess.StandardInput.Close();
    //string myString = myStreamReader.ReadToEnd();

    // wait exit signal from the app we called and then close it.

    output = myString;
# ---------- model_compile: C# additional code ----------
  private static System.Diagnostics.Process myProcess;
# ---------- end model_compile ----------
split = TextSplit(Text=model_compile, Separators=",")
multiplication = Multiplication(A=split, B=Slider(1, range=0..5))
merge_2 = Merge(Data1=flatten("0"), Data2=flatten(multiplication))
num = Number(graft(merge_2))
lng = ListLength(List=flatten(num))
flatten = FlattenTree(Tree=num, Path="{0}")
pt = Point(Point(0, 0, 0))
Z = UnitZ(Factor=num)
series = Series(Start=0, Step="1", Count=lng)
move = Move(Geometry=pt, Motion=Z)  # -> Geometry, Transform
panel_2 = Panel(flatten)
X = UnitX(Factor=series)  # -> graft(UnitVector)
move_2 = Move(Geometry=move.Geometry, Motion=X)  # -> Geometry, Transform
flatten_2 = FlattenTree(Tree=move_2.Geometry, Path="{0}")
intcrv = Interpolate(Vertices=flatten_2, Degree=3, Periodic=False, KnotStyle=1)  # -> Curve, Length, Domain
number_slider = Slider(0.09, range=0..100)
dom = ConstructDomain(DomainStart=expr("-x", number_slider), DomainEnd=number_slider)
pframe = PerpFrame(Curve=reparameterize(intcrv.Curve), Parameter=0)
rectangle = Rectangle(Plane=pframe, XSize=dom, YSize=dom, Radius=0)  # -> Rectangle, Length
swp1 = Sweep1(Rail=intcrv.Curve, Sections=rectangle.Rectangle, Miter=1)
cap = CapHoles(Brep=swp1)
